# Dynamo custom node FamilyInstance.SetType.dyf (Dynamo 0.7.2.3911)
# category: Clockwork.Revit.Elements.FamilyInstance.Actions
# Changes the family type of a given family instance to the specified type

Family_Instance_s = Input()  # "Family Instance(s)"
turn_into_list = Custom[Turn Into List](item=Family_Instance_s)  # Turns an element (or a nested list) into a flat list
Family_Type = Input()
python_script = Python(IN[0]=turn_into_list, IN[1]=Family_Type)
# ---------- python_script.python (28 lines) ----------
import clr
clr.AddReference('RevitAPI')
from Autodesk.Revit.DB import *

clr.AddReference("RevitNodes")
import Revit
clr.ImportExtensions(Revit.Elements)

clr.AddReference("RevitServices")
import RevitServices
from RevitServices.Persistence import DocumentManager
from RevitServices.Transactions import TransactionManager

doc = DocumentManager.Instance.CurrentDBDocument
faminsts = UnwrapElement(IN[0])
famsymb = UnwrapElement(IN[1])
elementlist = list()

TransactionManager.Instance.EnsureInTransaction(doc)
for item in faminsts:
	try:
		item.Symbol = famsymb
		elementlist.append(item.ToDSType(True))
	except:
		emptylist = list()
TransactionManager.Instance.TransactionTaskDone()

OUT = elementlist
# ----------------------------------------
return_list_or_single_value = Custom[Return List Or Single Value](list_1=turn_into_list, list_2=python_script)  # If the list in input #1 only contains one item, only the first item of the list in input #2 will be returned.
Output = Output(return_list_or_single_value)  # ""
