# Dynamo custom node List.ReplaceEmptyLists.dyf (Dynamo 0.7.5.3566)
# category: Clockwork.Core.List.Actions
# Replaces all empty lists within a given list with a substitute

list = Input()
isEmpty = List.IsEmpty()
map = List.Map(list, isEmpty)
code_block = CodeBlock(seq=map) { 0..List.Count(seq)-1; }
filterByBoolMask = List.FilterByBoolMask(code_block, map)
replacement = Input()
replaceItemAtIndex = Custom[List.ReplaceItemAtIndex](list=list, index_indices=filterByBoolMask, replacement=replacement)  # Replaces the item at a given index (or list of indices) of a list by another item
list_2 = Output(replaceItemAtIndex)  # "list"
