# Dynamo custom node List.ReplaceItemAtIndex.dyf (Dynamo 0.7.4.3180)
# category: Clockwork.Core.List.Actions
# Replaces the item at a given index of a list by another item

list = Input()
replacement = Input()
index = Input()
python_script = Python(IN[0]=list, IN[1]=replacement, IN[2]=index)
# ---------- python_script.python (5 lines) ----------
thelist = IN[0]
thereplacement = IN[1]
theindex = IN[2]
thelist[theindex] = thereplacement
OUT = thelist
# ----------------------------------------
list_2 = Output(python_script)  # "list"
