# Dynamo custom node Math.ScaleNormalized.dyf (Dynamo 0.7.2.2114)
# category: Clockwork.Core.Math.Actions.Normalization
# Scales a normalized value according to a given minimum and maximum

Min = Input()
Max = Input()
val = Input()
code_block = CodeBlock(min=Min, max=Max, value=val) { min+(max-min)*value; }
