# Dynamo custom node UV.PruneDuplicates.dyf (Dynamo 0.7.2.3911)
# category: Clockwork.Geometry.UV.Actions

uvlist = Input()
tol = Input()
code_block = CodeBlock(uvlist=uvlist, tol=tol)
# ---------- code_block.designscript (3 lines) ----------
plist1 = Point.ByCoordinates(uvlist.U,uvlist.V);
plist2 = plist1.PruneDuplicates(tol);
UV.ByCoordinates(plist2.X,plist2.Y);
# ----------------------------------------
Output = Output(code_block.out2)  # ""
