# Dynamo custom node Vector.IsInPlane.dyf (Dynamo 0.7.5.3566)
# category: Clockwork.Geometry.Vector.Query
# Checks if a given vector is located on a given plane

Vector = Input()
normalized = Vector.Normalized(Vector)
Plane = Input()
isParallelToPlane = Custom[Vector.IsParallelToPlane](Vector=normalized, Plane=Plane)  # Checks if a given vector is parallel to a given plane
Vector_Basepoint = Input()
isOutOfPlane = Custom[Point.IsOutOfPlane](Face_Plane=Plane, Point=Vector_Basepoint)  # Checks a list for XYZs that are not located on a given plane
not_ = Not(isOutOfPlane.bool)
create_list = List.Create(isParallelToPlane, not_)
allTrue = AllTrue(create_list)
bool = Output(allTrue)
