# Dynamo custom node All Families Of Category.dyf (Dynamo 1.3.0.875)
# category: Clockwork.Revit.Selection.ByCollector
# Gets all famiies of a given category in the model  (does *not *work for system families)

category = Input(category : Category)
toggle = Input(toggle : bool = true)
all_family_types_of_category = Custom[All Family Types Of Category](category=category, toggle=toggle)  # Gets all family types/symbols of a given category in the model (does *not *work for system families)
family = FamilyType.Family(all_family_types_of_category)
uniqueItems = List.UniqueItems(family)
families = Output(uniqueItems)
