# Dynamo custom node Document.ProjectParameters.dyf (Dynamo 1.3.0.875)
# category: Clockwork.Revit.Document.Query
# Retrieves all project parameters and the categories they have been assigned to

toggle = Input(toggle : bool = true)
python_script = Python(IN[0]=toggle)
# ---------- python_script.python (28 lines) ----------
import clr
clr.AddReference('RevitAPI')
from Autodesk.Revit.DB import *
import Autodesk

clr.AddReference("RevitNodes")
import Revit
clr.ImportExtensions(Revit.Elements)

clr.AddReference("RevitServices")
import RevitServices
from RevitServices.Persistence import DocumentManager

doc = DocumentManager.Instance.CurrentDBDocument
params = []
cats = []
iterator = doc.ParameterBindings.ForwardIterator()
while iterator.MoveNext():
	params.append(iterator.Key.Name)
	thesecats = []
	for cat in iterator.Current.Categories:
		try:
			thesecats.append(Revit.Elements.Category.ById(cat.Id.IntegerValue))
		except:
			# in case the category is not supported by Dynamo
			pass
	cats.append(thesecats)
OUT = (params,cats)
# ----------------------------------------
code_block = CodeBlock(seq=python_script) { seq[0]; seq[1]; }
paramName = Output(code_block.out0)
categories = Output(code_block.out1)
