# Dynamo custom node Door.Rooms.dyf (Dynamo 1.3.2.2480)
# category: Clockwork.Revit.Elements.Door.Query
# Gets the rooms that are connected by a given door

door = Input(door : FamilyInstance[]..[])
phase = Input(phase : var = null)  # If no phase is specified, the node will use the last phase in the project
isNull = Object.IsNull(phase)
phases = Custom[Document.Phases]()  # Retrieves all phases in the active document in *chronological* order
lastItem = List.LastItem(phases)
scopeIf = Custom[ScopeIf+](test=isNull, true=lastItem, false=phase)  # A (hopefully) more robust implementation of ScopeIf. Tests a single boolean and returns a value accordingly.
python_script = Python(IN[0]=door, IN[1]=scopeIf)
# ---------- python_script.python (21 lines) ----------
import clr
clr.AddReference('RevitAPI')
from Autodesk.Revit.DB import *

def GetRooms(item, phase):
	if hasattr(item, "FromRoom") and str(phase.GetType()) == "Autodesk.Revit.DB.Phase":
		exits = 0
		# Need to wrap this in try/except for doors/windows that don't exist in the given phase
		try: 
			if item.FromRoom[phase]: exits += 1
			if item.ToRoom[phase]: exits += 1
			return item.FromRoom[phase], item.ToRoom[phase], exits
		except:
			return None, None, 0
	else: return None, None, 0

items = UnwrapElement(IN[0])
phase = UnwrapElement(IN[1])

if isinstance(IN[0], list): OUT = map(list, zip(*[GetRooms(x, phase) for x in items]))
else: OUT = GetRooms(items, phase)
# ----------------------------------------
code_block = CodeBlock(seq=python_script) { seq[0]; seq[1]; seq[2]; }
fromRoom = Output(code_block.out0)
toRoom = Output(code_block.out1)
roomCount = Output(code_block.out2)
