# Dynamo custom node Element.ByID.dyf (Dynamo 1.0.0.1180)
# category: Clockwork.Revit.Selection.Miscellaneous
# Gets the Revit element(s) for a list of IDs (or a single ID)

ID_UniqueId = Input()  # "ID/UniqueId"
turnIntoList = Custom[Turn Into List](unknownItem=ID_UniqueId)  # Turns an element (or a nested list) into a flat list
python_script = Python(IN[0]=turnIntoList)
# ---------- python_script.python (26 lines) ----------
import clr
clr.AddReference('RevitAPI')
from Autodesk.Revit.DB import *

clr.AddReference("RevitNodes")
import Revit
clr.ImportExtensions(Revit.Elements)

clr.AddReference("RevitServices")
import RevitServices
from RevitServices.Persistence import DocumentManager

doc = DocumentManager.Instance.CurrentDBDocument
items = UnwrapElement(IN[0])

elementlist = list()
unmatched = list()
for item in items:
	try: 
		elementlist.append(doc.GetElement(item).ToDSType(True))
	except:
		try:
			elementlist.append(doc.GetElement(ElementId(item)).ToDSType(True))
		except:
			unmatched.append(item)
OUT = (elementlist, unmatched)
# ----------------------------------------
code_block = CodeBlock(seq=python_script) { seq[0]; seq[1]; }
returnListOrSingleValue = Custom[ReturnListOrSingleValue](unknownItem=ID_UniqueId, seq=code_block.out0)  # If the item in input #1 is not a list, only the first item of the list in input #2 will be returned.
element = Output(returnListOrSingleValue)
unmatched = Output(code_block.out1)
