# Dynamo custom node List.ReplaceItemAtIndex+.dyf (Dynamo 1.3.2.2480)
# category: Clockwork.Core.List.Actions
# Replaces the item at a given index of a list by another item. Unlike the OOTB node, it can replace items at multiple indeces.

seq = Input(seq : var[])
replacement = Input(replacement : var[])
indices = Input(indices : int[])
python_script = Python(IN[0]=seq, IN[1]=replacement, IN[2]=indices)
# ---------- python_script.python (9 lines) ----------
_list = IN[0]
rValues = IN[1]
iValues = IN[2]
if len(iValues) > 1 and len(rValues) == 1:
	rValues = [rValues[0]] * len(iValues)
if len(iValues) > 0:
	for (index, value) in zip(iValues, rValues):
		_list[index] = value
OUT = _list
# ----------------------------------------
seq_2 = Output(python_script)  # "seq"
