# Dynamo custom node View.PermanentlyIsolateCategory.dyf (Dynamo 1.3.1.1736)
# category: Clockwork.Revit.Views.View.Actions
# Permanently isolates categories in the given view

view = Input()
view_2 = Output(view)  # "view"
category = Input()
category_2 = Output(category)  # "category"
temporarilyIsolateCategory = Custom[View.TemporarilyIsolateCategory](view=view, category=category)  # Temporarily isolates categories in the given view
convertTemporaryHideIsolateToPermanent = Custom[View.ConvertTemporaryHideIsolateToPermanent](view=temporarilyIsolateCategory.view)  # Convert all temporary hidden elements or categories to permanently hidden in the given view.
success = Output(convertTemporaryHideIsolateToPermanent.success)
