# Dynamo custom node All Families Of Category.dyf (Dynamo 2.0.1.5055)
# category: Clockwork.Revit.Selection.Collectors.Query
# Gets all famiies of a given category in the model  (does *not *work for system families)

category = Input(category: Revit.Elements.Category)
toggle = Input(toggle: bool = true)
docOrRevitLinkInstance = Input(docOrRevitLinkInstance: var = null)  # Use only if you want to query a linked model
python_script = Python(IN[0]=category, IN[1]=toggle, IN[2]=docOrRevitLinkInstance)
# ---------- python_script.python (21 lines) ----------
import System
import clr
clr.AddReference('RevitAPI')
from Autodesk.Revit.DB import *

clr.AddReference("RevitServices")
import RevitServices
from RevitServices.Persistence import DocumentManager

def ElementTypesByCategory(cat, doc):
	collector = FilteredElementCollector(doc).OfClass(Family)
	return [x for x in collector.ToElements() if x.FamilyCategoryId.IntegerValue == cat.Id]

inputdoc = UnwrapElement(IN[2])
if not inputdoc: doc = DocumentManager.Instance.CurrentDBDocument
elif inputdoc.GetType().ToString() == "Autodesk.Revit.DB.RevitLinkInstance": doc = inputdoc.GetLinkDocument()
elif inputdoc.GetType().ToString() == "Autodesk.Revit.DB.Document": doc = inputdoc
else: doc = DocumentManager.Instance.CurrentDBDocument

if isinstance(IN[0], list): OUT = [ElementTypesByCategory(x, doc) for x in IN[0]]
else: OUT = ElementTypesByCategory(IN[0], doc)
# ----------------------------------------
families = Output(python_script)
