# Dynamo custom node Document.DesignOptions.dyf (Dynamo 2.0.1.5055)
# category: Clockwork.Revit.Application.Query
# Returns all design options in the model, grouped by design option set

element_types = ElementTypes(index=69)  # graph input
all_elements_of_type = ElementsOfType(element_type=element_types)
designOptionSet = Custom[DesignOption.DesignOptionSet](designOption=all_elements_of_type)  # Returns the design option set of a given design option
groupByKey = List.GroupByKey(list=all_elements_of_type, keys=designOptionSet)
DesignOptions = Output(groupByKey.groups)
DesignOptionSets = Output(groupByKey.unique_keys)
