# Dynamo custom node Room.Boundaries.dyf (Dynamo 1.3.1.1736)
# category: Clockwork.Revit.Elements.Room.Query
# Gets a list of all boundaries of a given room or area and a corresponding list of the elements that are generating those boundaries.

room = Input()
version = Custom[Application.Version]()  # Retrieves the name, version and build of the current Revit application.
python_script = Python(IN[0]=room, IN[1]=version.Version)
# ---------- python_script.python (32 lines) ----------
import clr
clr.AddReference('RevitAPI')
from Autodesk.Revit.DB import *
import Autodesk

clr.AddReference("RevitNodes")
import Revit
clr.ImportExtensions(Revit.GeometryConversion)

def GetRoomBoundaries(item, version):
	doc = item.Document
	calculator = SpatialElementGeometryCalculator(doc)
	options = Autodesk.Revit.DB.SpatialElementBoundaryOptions()
	# get boundary location from area computation settings
	boundloc = Autodesk.Revit.DB.AreaVolumeSettings.GetAreaVolumeSettings(doc).GetSpatialElementBoundaryLocation(SpatialElementType.Room)
	options.SpatialElementBoundaryLocation = boundloc
	# get boundary segments
	elements = []
	curves = []
	try:
		for boundarylist in item.GetBoundarySegments(options):
			for boundary in boundarylist:
				elements.append(doc.GetElement(boundary.ElementId))
				if version > 2016: curves.append(boundary.GetCurve().ToProtoType())
				else: curves.append(boundary.Curve.ToProtoType())
	except: pass
	return elements, curves

items = UnwrapElement(IN[0])

if isinstance(IN[0], list): OUT = map(list, zip(*[GetRoomBoundaries(x, IN[1]) for x in items]))
else: OUT = GetRoomBoundaries(items, IN[1])
# ----------------------------------------
firstItem = List.FirstItem(python_script)
elements = Output(firstItem)
lastItem = List.LastItem(python_script)
curves = Output(lastItem)
