# Dynamo graph Core.Logic.dyn (Dynamo 0.7.5.3566)

code_block = CodeBlock { 2..6; }
code_block_2 = CodeBlock { 1..4; }
string = StringInput("""A
B
C
D""")
string_2 = StringInput("\n")
split = String.Split(string, string_2)
watch = Watch(split)
string_3 = StringInput("E")
switch = Custom[Switch](cases=code_block_2, values=watch, default=string_3)  # Emulates the Switch/Case statement that is available in multiple programming languages.
map = List.Map(code_block, switch)
watch_2 = Watch(map)
code_block_3 = CodeBlock { 1; 4; }
create = List.Create(code_block_3.out1)
returnListOrSingleValue = Custom[ReturnListOrSingleValue](item_1_unknown=code_block_3.out0, item_2_list=create)  # If the item in input #1 is not a list, only the first item of the list in input #2 will be returned.
watch_3 = Watch(returnListOrSingleValue)
create_2 = List.Create(code_block_3.out0)
returnListOrSingleValue_2 = Custom[ReturnListOrSingleValue](item_1_unknown=create_2, item_2_list=create)
watch_4 = Watch(returnListOrSingleValue_2)
