# Dynamo graph Revit.Elements.CurtainPanel.dyn (Dynamo 1.3.1.1736)

# note: Run this script with the CurtainPanel_Sample file in the extra folder.
categories = Categories("CurtainWallPanels")
all_elements_of_category = ElementsOfCategory(categories)
watch = Watch(all_elements_of_category)
hostPanel = Custom[CurtainPanel.HostPanel](curtainPanel=watch)  # Retrieves the host panel of a given curtain panel. This is typcially needed when wanting to access wall elements used as curtain panels. If no host panel is found, the node will return the input panel instead.
watch_2 = Watch(hostPanel)
