# Dynamo graph Revit.Elements.DesignOption.dyn (Dynamo 2.0.1.5055)

designOptions = Custom[Document.DesignOptions]()  # Returns all design options in the model, grouped by design option set
watch = Watch(designOptions.DesignOptions)
designOptionSet = Custom[DesignOption.DesignOptionSet](designOption=watch@L2)  # Returns the design option set of a given design option
watch_2 = Watch(designOptionSet)
element_name_universal = Custom[Element.Name (Universal)](element=watch)  # Gets an element's name (Dynamo's built-in Name nodes don't work for all element types, e.g. worksets...)
watch_3 = Watch(element_name_universal)
isPrimary = Custom[DesignOption.IsPrimary](designOption=watch)  # Determines whether a given design option is the primary option in its set
watch_4 = Watch(isPrimary)
