# Dynamo graph Revit.Elements.DirectShape.dyn (Dynamo 2.0.1.5055)

select_model_elements = DSModelElementsSelection()  # 13 picked in the model; graph input
watch = Watch(select_model_elements)
detail_level = DetailLevel(index=1)  # graph input
geometry = Custom[Element.Geometry+](element=watch, detailLevel=detail_level)  # Returns Dynamo AND native Revit geometry of a given element
watch_2 = Watch(geometry.revitGeometry)
categories = Categories(index=216)  # graph input
element_name_universal = Custom[Element.Name (Universal)](element=watch)  # Gets an element's name (Dynamo's built-in Name nodes don't work for all element types, e.g. worksets...)
count = List.Count(list=element_name_universal)
code_block = CodeBlock(name=element_name_universal, n=count) { name + "_" + (1..n); }
fromRevitGeometry = Custom[DirectShape.FromRevitGeometry](revitGeometry=watch_2, category=categories, name=code_block)  # Creates a DirectShape from native Revit geometry objects
watch_3 = Watch(fromRevitGeometry)
