# Dynamo graph Revit.Elements.FillPatternElement.dyn (Dynamo 2.0.1.5055)

element_types = ElementTypes(index=126)  # graph input
all_elements_of_type = ElementsOfType(element_type=element_types)
isSolidFill = Custom[FillPatternElement.IsSolidFill](fillPatternElement=all_elements_of_type)  # Checks if the given FillPatternElement is a solid fill
filterByBoolMask = List.FilterByBoolMask(list=all_elements_of_type, mask=isSolidFill)
name = Custom[Element.Name+](element=filterByBoolMask.in)  # Gets an element's name (Dynamo's built-in Name nodes don't work for all element types, e.g. worksets...)
