# Dynamo graph Revit.Elements.Group.dyn (Dynamo 2.0.1.5055)

# note: You can use the Sample Architecture Project (Basic) that ships with Revit to run this graph.
element_types = ElementTypes(index=144)  # graph input
all_elements_of_type = ElementsOfType(element_type=element_types)
watch = Watch(all_elements_of_type)
members = Custom[Group.Members](group=watch)  # Retrieves the members of a group
watch_2 = Watch(members)
select_model_elements = DSModelElementsSelection()  # 5 picked in the model; graph input
code_block = CodeBlock { "Trees"; }
fromElements = Custom[Group.FromElements](elements=select_model_elements, groupName=code_block)  # Creates a group from a list of Revit elements
watch_3 = Watch(fromElements.ungroupableElements)
watch_4 = Watch(fromElements.group)
ungroup = Custom[Group.Ungroup](group=watch_4)  # Ungroups a group and returns the ungrouped elements.
watch_5 = Watch(ungroup)
element_types_2 = ElementTypes(index=145)  # graph input
all_elements_of_type_2 = ElementsOfType(element_type=element_types_2)
groups = Custom[GroupType.Groups](groupType=all_elements_of_type_2)  # Returns all group instances of a given group type
deconstruct = List.Deconstruct(list=groups@L2)
watch_6 = Watch(deconstruct.first)
watch_7 = Watch(deconstruct.rest)
isMirrored = Custom[Group.IsMirrored](referenceGroup=watch_6@L1, groupsToCheck=watch_7@L2)  # Checks if a list of group instances have been mirrored. The reference group should usually be the first placed instance of the group (since that one has linkely not been mirrored). The node will return null for group instances of other group types than the reference group as well as for group instances with excluded members. Furthermore, it will return null for *all* groups if the reference group itself has excluded members or if it doesn't contain any loadable families (since they are the only way of determining if the group instance has been mirrored).
watch_8 = Watch(isMirrored)
