# Dynamo graph Revit.Elements.ImportInstance.dyn (Dynamo 1.3.1.1736)

element_types = ElementTypes("ImportInstance")
all_elements_of_type = ElementsOfType(element_types)
watch = Watch(all_elements_of_type)
isLinked = Custom[ImportInstance.IsLinked](importInstance=watch)  # Determines whether an ImportInstance is linked or not
watch_2 = Watch(isLinked)
