# Dynamo graph Revit.Elements.ParameterFilterElement.dyn (Dynamo 2.0.3.8810)

element_types = ElementTypes(index=221)  # graph input
all_elements_of_type = ElementsOfType(element_type=element_types)
filterRuleString = Custom[ParameterFilterElement.FilterRuleString](parameterFilterElement=all_elements_of_type)  # Aggregates the filter rules of a given ParameterFilterElement into a human-readable string
watch = Watch(filterRuleString)
