# Dynamo graph Revit.Elements.Part.dyn (Dynamo 1.0.0.1180)

# note: Run this graph on the Parts_Sample file in the extra folder.
categories = Categories("Parts")
all_elements_of_category = ElementsOfCategory(categories)
watch = Watch(all_elements_of_category)
sourceElement = Custom[Part.SourceElement](part=watch)  # Retrieves the element a given part was made from
watch_2 = Watch(sourceElement)
