# Dynamo graph Revit.Elements.RoomTag.dyn (Dynamo 1.3.1.1736)

categories = Categories("RoomTags")
all_elements_of_category = ElementsOfCategory(categories)
watch = Watch(all_elements_of_category)
room = Custom[RoomTag.Room](roomTag=watch)  # Returns the room of a given room tag
watch_2 = Watch(room)
element_types = ElementTypes("FamilySymbol")
all_elements_of_type = ElementsOfType(element_types)
isOfCategory = Custom[Element.IsOfCategory](element=all_elements_of_type, category=categories)  # Checks whether an element is of a specified category
filterByBoolMask = List.FilterByBoolMask(list=all_elements_of_type, mask=isOfCategory)
watch_3 = Watch(filterByBoolMask.in)
firstItem = List.FirstItem(watch_3)
count = List.Count(watch)
ofRepeatedItem = List.OfRepeatedItem(item=firstItem, amount=count)
setType = Custom[RoomTag.SetType](roomTag=watch, roomTagType=ofRepeatedItem)  # Changes the family type of a given room tag to the specified type
watch_4 = Watch(setType.roomTag)
watch_5 = Watch(setType.success)
