# Dynamo graph Revit.Elements.Wall.Query.dyn (Dynamo 1.0.0.1180)

categories = Categories("Walls")
# note: You can use the Sample Architecture Project (Basic) that ships with Revit to run this graph.
all_elements_of_category = ElementsOfCategory(categories)
watch = Watch(all_elements_of_category)
creationMethod = Custom[Wall.CreationMethod](wall=watch)  # Retrieves the creation method of a given wall
watch_2 = Watch(creationMethod)
orientation = Custom[Wall.Orientation](wall=watch)  # Gets the orientation of a given wall instance (normal of the exterior face of the wall). Will *not* work for walls hosted on mass faces or in-place walls.
watch_3 = Watch(orientation)
