# Dynamo graph Revit.Views.Schedule.dyn (Dynamo 2.0.1.5055)

element_types = ElementTypes(index=327)  # graph input
all_elements_of_type = ElementsOfType(element_type=element_types)
keyScheduleParameterName = Custom[Schedule.KeyScheduleParameterName](schedule=all_elements_of_type)  # If the schedule is a key schedule, the node returns the name of the key schedule parameter.
watch = Watch(keyScheduleParameterName)
